# Dynamo graph Building Generator.dyn (Dynamo 2.0.2.6826)

string = StringInput("U")
XY = Plane.XY()
length = DoubleSlider(20, range=0..100 step 1)
width = DoubleSlider(20, range=0..100 step 1)
depth = DoubleSlider(8, range=0..30 step 1)
total_floor_area = DoubleSlider(339, range=0..10000 step 1)
floor_height = DoubleSlider(11, range=0..40 step 1)
boolean = BoolSelector(false)
buildingGenerator = Buildings.Creation.BuildingGenerator(Type=string, BasePlane=XY, Length=length, Width=width, Depth=depth, BldgArea=total_floor_area, FloorHeight=floor_height, CreateCore=boolean)
code_block = CodeBlock()
# ---------- code_block.designscript (6 lines) ----------
[
	Point.ByCoordinates(30, 0),
	Point.ByCoordinates(0, 30),
	Point.ByCoordinates(-30, 0),
	Point.ByCoordinates(0, -18)
];
# ----------------------------------------
boolean_2 = BoolSelector(true)
byControlPoints = NurbsCurve.ByControlPoints(points=code_block, closeCurve=boolean_2)
setback = DoubleSlider(3, range=0..20 step 1)
max_height = DoubleSlider(50, range=0..500 step 1)
siteMassGenerator = Site.Creation.SiteMassGenerator(SiteObject=byControlPoints, SetbackAmnt=setback, HeightLimit=max_height)
